# Grasshopper definition test3.gh (Grasshopper 1.0.7)
# plug-ins: Bifocals

gallery = ImageGallery(CycleDelay=30, Randomize=False, UseLocalImages=True, UseRemoteImages=True)
path = FilePath("C:\Users\ykish\OneDrive\デスクトップ\RebarRIRToolkit\gh_scripts\gh_test.py")
file = ReadFile(File=path, PerLineParse=False)
panel = Panel(file)
python = GhPythonScript(Code=file)  # -> Out, A
panel_2 = Panel(python.A)

# ----
# Color Format
# Input
data = Data(1)
# Method
data_2 = Data(1)
# Output
data_3 = Data(1)
# Display
data_4 = Data(1)
# Unuse
data_5 = Data(1)
